# Grasshopper definition gsr line-- skill2.gh (Grasshopper 1.0.7)
# plug-ins: Heron, Kangaroo2 Components

# ----
# READ FILE
file_path = FilePath("F:\BaiduSyncdisk\ucl\rc15\场地调研\数据\测试数据（路线）\GSR17号中午11：21-12：19.csv")
read_file = ReadFile(File=file_path, PerLineParse=True)
cull_index = CullIndex(List=read_file, Indices="0", Wrap=True)  # -> simplify(List)
panel = Panel(read_file)
tab = Panel(",")
text_split = TextSplit(Text=cull_index, Separators=tab)
panel_2 = Panel(text_split)
list_item = ListItem(List=text_split, Index="5", Wrap=True)  # -> Item, Item1

lat = Panel("45.432255")
# CONVERT COORDINATES
long = Panel("12.357692")
# SET ANCHOR POINT
boolean_toggle = BooleanToggle(True)
set_earthanchorpoint = SetEarthAnchorPoint(SetEAP=boolean_toggle, Latitude=lat, Longitude=long)

# ----
# IMPORT AND FILTER OSM
# Field values of OSM are here:
# https://wiki.openstreetmap.org/wiki/Map_features
# you can test example values here:
# https://www.openstreetmap.org/node/6429327326
# 
# The format is
# [Key],[Value]
filterfiields = Panel("natural")
file_path_2 = FilePath("F:\BaiduSyncdisk\ucl\rc15\场地调研\数据\出图\map Venice")
geometry = Geometry(<curve referenced from the Rhino model>)
import_osm = ImportOSM(Boundary=geometry, OSMDataLocation=file_path_2, Clipped=True)  # -> Extents, Fields, Values, FeatureGeometry, Buildings
panel_3 = Panel("addr:postcode,SE1 7ND")
panel_4 = Panel("amenity,cafe")
filterfieldvalue = Panel("natural,tree")

flatten_tree = FlattenTree(Tree=list_item.Item, Path="{0}")
flatten_tree_2 = FlattenTree(Tree=list_item.Item1, Path="{0}")
decimal_degrees_to_xy = DecimalDegreesToXY(Latitude=flatten_tree, Longitude=flatten_tree_2)  # -> XyPoint, Transform
panel_5 = Panel("""1551
2191""")
panel_6 = Panel(decimal_degrees_to_xy.XyPoint)
cull_index_2 = CullIndex(List=decimal_degrees_to_xy.XyPoint, Indices=panel_5, Wrap=True)
point_list = PointList(Points=cull_index_2, Size="1")

panel_7 = Panel(file_path)
filterfieldvalue_2 = Panel("[Key],[Value]")
panel_8 = Panel(list_item.Item)
deconstruct = Deconstruct(Point=cull_index_2)  # -> XComponent, YComponent, ZComponent
larger_than = LargerThan(FirstNumber=deconstruct.XComponent, SecondNumber=Slider(-100000, range=-100000..0))  # -> LargerThan, OrEqualTo
list_item_2 = ListItem(List=text_split, Index="8", Wrap=True)  # -> Item, Item1
panel_9 = Panel("""1551
2191""")
number_slider = Slider(0, range=0..10)
panel_10 = Panel(list_item_2.Item)
cull_index_3 = CullIndex(List=flatten(list_item_2.Item), Indices=panel_9, Wrap=True)
multiplication = Multiplication(A=cull_index_3, B=Slider(2, range=0..50))
construct_point = ConstructPoint(XCoordinate=deconstruct.XComponent, YCoordinate=deconstruct.YComponent, ZCoordinate=flatten(multiplication))
cull_pattern = CullPattern(List=construct_point, CullPattern=larger_than.LargerThan)
removeduplicatepts = RemoveDuplicatePts(Points=cull_pattern, Tolerance=Slider(3, range=0..100))
polyline = PolyLine(Vertices=removeduplicatepts, Closed=False)
custom_preview = CustomPreview(Geometry=polyline, Material=ColourSwatch(SwatchColor=RGB(255, 255, 255)))
