# Grasshopper definition mask sentiment analysis.gh (Grasshopper 1.0.7)
# plug-ins: Heron, Kangaroo2 Components

# ----
# READ FILE
file_path = FilePath("F:\BaiduSyncdisk\ucl\skill submission\flickr_venice_sentiment_points_tiered.csv")
read_file = ReadFile(File=file_path, PerLineParse=True)
cull_index = CullIndex(List=read_file, Indices="0", Wrap=True)  # -> simplify(List)
panel = Panel(read_file)
tab = Panel(",")
text_split = TextSplit(Text=cull_index, Separators=tab)
panel_2 = Panel(text_split)
list_item = ListItem(List=text_split, Index="0", Wrap=True)  # -> Item, Item1

lat = Panel("45.432255")
# CONVERT COORDINATES
long = Panel("12.357692")
# SET ANCHOR POINT
boolean_toggle = BooleanToggle(True)
set_earthanchorpoint = SetEarthAnchorPoint(SetEAP=boolean_toggle, Latitude=lat, Longitude=long)

# ----
# IMPORT AND FILTER OSM
# Field values of OSM are here:
# https://wiki.openstreetmap.org/wiki/Map_features
# you can test example values here:
# https://www.openstreetmap.org/node/6429327326
# 
# The format is
# [Key],[Value]
filterfiields = Panel("natural")
file_path_2 = FilePath("F:\BaiduSyncdisk\ucl\rc15\场地调研\数据\出图\map Venice")
geometry = Geometry(<curve referenced from the Rhino model>)
import_osm = ImportOSM(Boundary=geometry, OSMDataLocation=file_path_2, Clipped=True)  # -> Extents, Fields, Values, FeatureGeometry, Buildings
panel_3 = Panel("addr:postcode,SE1 7ND")
panel_4 = Panel("amenity,cafe")
filterfieldvalue = Panel("natural,tree")

flatten_tree = FlattenTree(Tree=list_item.Item, Path="{0}")
flatten_tree_2 = FlattenTree(Tree=list_item.Item1, Path="{0}")
decimal_degrees_to_xy = DecimalDegreesToXY(Latitude=flatten_tree, Longitude=flatten_tree_2)  # -> XyPoint, Transform
panel_5 = Panel("""1551
2191""")
panel_6 = Panel(decimal_degrees_to_xy.XyPoint)
cull_index_2 = CullIndex(List=decimal_degrees_to_xy.XyPoint, Indices=panel_5, Wrap=True)
point_list = PointList(Points=cull_index_2, Size="1")

panel_7 = Panel(file_path)
filterfieldvalue_2 = Panel("[Key],[Value]")
panel_8 = Panel(list_item.Item)
deconstruct = Deconstruct(Point=cull_index_2)  # -> XComponent, YComponent, ZComponent
larger_than = LargerThan(FirstNumber=deconstruct.XComponent, SecondNumber=Slider(-100000, range=-100000..0))  # -> LargerThan, OrEqualTo
list_item_2 = ListItem(List=text_split, Index="2", Wrap=True)  # -> Item, Item1
panel_9 = Panel("""1551
2191""")
number_slider = Slider(500, range=0..500)  # disabled
number_slider_2 = Slider(500, range=0..500)  # disabled
panel_10 = Panel(list_item_2.Item)
cull_index_3 = CullIndex(List=flatten(list_item_2.Item), Indices=panel_9, Wrap=True)
number_slider_3 = Slider(20, range=0..500)  # disabled
rectangle = Rectangle(Plane=PlaneXY(0, 0, 0), XSize=number_slider, YSize=number_slider_2, Radius=0)  # -> Rectangle, Length; disabled
multiplication = Multiplication(A=cull_index_3, B=Slider(50, range=0..50))
construct_point = ConstructPoint(XCoordinate=deconstruct.XComponent, YCoordinate=deconstruct.YComponent, ZCoordinate=flatten(multiplication))
cull_pattern = CullPattern(List=construct_point, CullPattern=larger_than.LargerThan)
removeduplicatepts = RemoveDuplicatePts(Points=cull_pattern, Tolerance=Slider(50, range=0..100))
boundary_surfaces = BoundarySurfaces(Edges=rectangle.Rectangle)  # disabled
deconstruct_2 = Deconstruct(Point=removeduplicatepts)  # -> XComponent, YComponent, ZComponent; disabled
divide_domain² = DivideDomain²(Domain=boundary_surfaces, UCount=number_slider_3, VCount=Slider(20, range=0..500))  # disabled
delaunay_mesh = DelaunayMesh(Points=removeduplicatepts, Plane=PlaneXY(0, 0, 0))
construct_point_2 = ConstructPoint(XCoordinate=deconstruct_2.XComponent, YCoordinate=deconstruct_2.YComponent, ZCoordinate=0)  # disabled
isotrim = Isotrim(Surface=boundary_surfaces, Domain=divide_domain²)  # disabled
subd_from_mesh = SubDFromMesh(Mesh=delaunay_mesh, Creases=1, Corners=1, Interpolate=False)
number_slider_4 = Slider(0.25, range=0..1)  # disabled
area = Area(Geometry=isotrim)  # -> Area, Centroid; disabled
deconstruct_3 = Deconstruct(Point=area.Centroid)  # -> XComponent, YComponent, ZComponent; disabled
multiplication_2 = Multiplication(B=number_slider_4)  # disabled
point_charge = PointCharge(Point=construct_point_2, Charge=multiplication_2, Decay=2)  # disabled
evaluate_field = EvaluateField(Field=point_charge, Point=area.Centroid)  # -> Tensor, Strength; disabled
construct_point_3 = ConstructPoint(XCoordinate=deconstruct_3.XComponent, YCoordinate=deconstruct_3.YComponent, ZCoordinate=evaluate_field.Strength)  # disabled
polyline = PolyLine(Closed=False)
unit_z = UnitZ(Factor=1)
xy_plane = XYPlane(Origin=Point(0, 0, 0))
number_slider_5 = Slider(100, range=0..100)
custom_preview = CustomPreview(Geometry=polyline, Material=ColourSwatch(SwatchColor=RGB(255, 255, 255)))
contour = Contour(Shape=subd_from_mesh, Point=xy_plane, Direction=unit_z, Distance=Slider(20, range=0..100))  # -> flatten(Contours)
number_slider_6 = Slider(0, range=0..100)
curve = Curve(<curve referenced from the Rhino model>)
boundary_surfaces_2 = BoundarySurfaces(Edges=curve)
unit_z_2 = UnitZ(Factor=Slider(2200, range=0..10000))
extrude = Extrude(Base=boundary_surfaces_2, Direction=expr("-x", unit_z_2))
trim_with_brep = TrimWithBrep(Curve=contour, Brep=extrude)  # -> Inside, Outside
curve_2 = Curve(flatten(trim_with_brep.Inside))
curve_middle = CurveMiddle(Curve=curve_2)
deconstruct_4 = Deconstruct(Point=curve_middle)  # -> XComponent, YComponent, ZComponent
bounds = Bounds(Numbers=deconstruct_4.ZComponent)
deconstruct_domain = DeconstructDomain(Domain=bounds)  # -> Start, End
gradient = Gradient(
    LowerLimit=deconstruct_domain.Start,
    UpperLimit=deconstruct_domain.End,
    Parameter=deconstruct_4.ZComponent,
    stops=[0: RGB(0, 0, 255), 0: RGB(44, 32, 112), 0: RGB(192, 0, 192), 0: RGB(34, 173, 150), 0: RGB(234, 202, 193), 0: RGB(64, 194, 216)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])
custom_preview_2 = CustomPreview(Geometry=curve_2, Material=gradient)
